# Grasshopper definition BranchNodeRnd2.gh (Grasshopper 1.0.7)
# plug-ins: LunchBox, Weaverbird

# ---- group: RH_IN:201:Length
branch_length = Slider(10, range=0..10)

# ---- group: RH_IN:201:Radius
cell_radius = Slider(10, range=0..10)

# ---- group: RH_IN:201:Count
number_slider = Slider(100, range=1..100)

# ----
number_slider_2 = Slider(1, range=0..1)
addition = Addition(A=cell_radius, B=number_slider_2)
series = Series(Start=0, Step=Slider(20, range=0..100), Count=Slider(3, range=0..10))
addition_2 = Addition(A=branch_length, B=number_slider_2)
pt = ConstructPoint(XCoordinate=0, YCoordinate=0, ZCoordinate=series)
dom = ConstructDomain(DomainStart=0, DomainEnd=number_slider)
lng = ListLength(List=pt)
cir = Circle(Plane=pt, Radius=1)
range = Range(Domain=dom, Steps=expr("x-1", lng))
scale_nu = ScaleNU(Geometry=cir, Plane=pt, ScaleX=addition, ScaleY=addition_2, ScaleZ=1)  # -> Geometry, Transform
rad = Radians(Degrees=range)
rotate = Rotate(Geometry=scale_nu.Geometry, Angle=rad, Plane=PlaneXY(0, 0, 0))  # -> Geometry, Transform
number_slider_3 = Slider(20, range=0..100)
loft = Loft(Curves=rotate.Geometry, Options={Adjust=False, Closed=False, LoftEnds=0, LoftSimp=0, LoftType=0, Rebuild=10, Refit=0.01})
diamond = DiamondPanels(Surface=loft, UDivisions=number_slider_3, VDivisions=number_slider_3)  # -> DiamondPanels, TriPanels
smesh = SimpleMesh(Brep=flatten([diamond.DiamondPanels, diamond.TriPanels]))
mjoin = MeshJoin(Meshes=smesh)
wbjoin = WeaverbirdsJoinMeshesAndWeld(Mesh=mjoin, Weld=True)
weld = WeldMesh(Mesh=wbjoin, Angle=3.141592654)
alignvert = AlignVertices(Mesh=weld, Tolerance=0.1)  # -> Result, Count

# ---- group: Mesh to SubD -> SubD to Mesh
c_script = CSharpScript(m=alignvert.Result)  # -> out, A; inputs m: Mesh
# ---------- c_script: C# ----------
    A = Mesh.CreateFromSubD(SubD.CreateFromMesh(m), 2);
# ---------- end c_script ----------

# ----
flipm = FlipMesh(Mesh=c_script.A, VertexNormals=True, FaceNormals=True, FaceOrientation=True)

# ---- group: RH_OUT:115:Mesh
mesh = Mesh(flipm)

# ----
preview = CustomPreview(Geometry=mesh, Material=ColourSwatch(SwatchColor=RGB(255, 255, 255)))
