# Grasshopper definition BranchNodeRnd8.gh (Grasshopper 1.0.7)
# plug-ins: LunchBox, MeshEdit Components

# ---- group: RH_IN:201:Length
branch_length = Slider(10, range=0..10)

# ---- group: RH_IN:201:Radius
cell_radius = Slider(10, range=0..10)

# ---- group: RH_IN:201:Count
number_slider = Slider(100, range=1..100)

# ----
number_slider_2 = Slider(4, range=0..10)
series = Series(Start=0, Step=Slider(30, range=0..100), Count=number_slider_2)
addition = Addition(A=cell_radius, B=Slider(1, range=0..1))
addition_2 = Addition(A=branch_length, B=Slider(1, range=0..1))
dom = ConstructDomain(DomainStart=0, DomainEnd=number_slider)
pt = ConstructPoint(XCoordinate=0, YCoordinate=0, ZCoordinate=series)
sph = Sphere(Base=PlaneXY(0, 0, 0), Radius=cell_radius)
cir = Circle(Plane=pt, Radius=1)
range = Range(Domain=dom, Steps=expr("x-1", number_slider_2))
scale_nu = ScaleNU(Geometry=cir, Plane=PlaneXY(0, 0, 0), ScaleX=addition, ScaleY=addition_2, ScaleZ=1)  # -> Geometry, Transform
popgeo = PopulateGeometry(Geometry=sph, Count=number_slider, Seed=1)
rad = Radians(Degrees=range)
facet = FacetDome(Points=popgeo, Radius=cell_radius)  # -> Pattern, Dome
rotate = Rotate(Geometry=scale_nu.Geometry, Angle=rad, Plane=PlaneXY(0, 0, 0))  # -> Geometry, Transform
number_slider_3 = Slider(20, range=0..100)
boundary = BoundarySurfaces(Edges=facet.Pattern)
loft = Loft(Curves=rotate.Geometry, Options={Adjust=False, Closed=False, LoftEnds=0, LoftSimp=0, LoftType=0, Rebuild=10, Refit=0.01})
pt_2 = ConstructPoint(XCoordinate="0.5", YCoordinate="0.5", ZCoordinate=0)
diamond = DiamondPanels(Surface=loft, UDivisions=number_slider_3, VDivisions=number_slider_3)  # -> DiamondPanels, TriPanels
evalsrf = EvaluateSurface(Surface=reparameterize(boundary), Point=pt_2)  # -> Point, Normal, UDirection, VDirection, Frame
smesh = SimpleMesh(Brep=flatten([diamond.DiamondPanels, diamond.TriPanels]))
cap = CapHoles(Brep=loft)
deplane = DeconstructPlane(Plane=evalsrf.Frame)  # -> Origin, XAxis, YAxis, ZAxis
mjoin = MeshJoin(Meshes=smesh)
amp = Amplitude(Vector=deplane.ZAxis, Amplitude=branch_length)
weldvertices = MeshWeldVertices(Mesh=mjoin, Tolerance=0.01)  # -> RuntimeMessage, Mesh
move = Move(Geometry=facet.Pattern, Motion=amp)  # -> Geometry, Transform
explode = Explode(Curve=facet.Pattern, Recursive=True)  # -> graft(Segments), Vertices
explode_2 = Explode(Curve=move.Geometry, Recursive=True)  # -> graft(Segments), Vertices

# ---- group: Generate caps
cp = ControlPoints(Curve=move.Geometry)  # -> Points, Weights, Knots
shift = ShiftList(List=cp.Points, Shift=1, Wrap=invert(True))
del = DelaunayMesh(Points=shift, Plane=PlaneXY(0, 0, 0))
quad = Quadrangulate(Mesh=del, Angle=Slider(1, range=0..1), Ratio=Slider(0, range=0..1))  # -> flatten(Mesh), Count

# ----
weld = WeldMesh(Mesh=weldvertices.Mesh, Angle=3.141592654)
end = EndPoints(Curve=explode.Segments)  # -> Start, End
end_2 = EndPoints(Curve=explode_2.Segments)  # -> Start, End
merge = Merge(Data1=end.Start, Data2=end_2.Start, Data3=end_2.End, Data4=end.End)
conmesh = ConstructMesh(Vertices=merge, Faces={A=0, B=1, C=2, D=3})
mjoin_2 = MeshJoin(Meshes=flatten(conmesh))
alignvert = AlignVertices(Mesh=mjoin_2, Tolerance=0.1)  # -> Result, Count
mesh = Mesh(quad.Mesh)
weld_2 = WeldMesh(Mesh=alignvert.Result, Angle=3.141592654)
mjoin_3 = MeshJoin(Meshes=flatten([weld_2, mesh]))
alignvert_2 = AlignVertices(Mesh=weldvertices.Mesh, Tolerance=0.1)  # -> Result, Count
weld_3 = WeldMesh(Mesh=alignvert_2.Result, Angle=3.141592654)

# ---- group: Mesh to SubD -> SubD to Mesh
c_script = CSharpScript(m=weld_3)  # -> out, A; inputs m: Mesh
# ---------- c_script: C# ----------
    A = Mesh.CreateFromSubD(SubD.CreateFromMesh(m), 2);
# ---------- end c_script ----------

# ----
flipm = FlipMesh(Mesh=c_script.A, VertexNormals=True, FaceNormals=True, FaceOrientation=True)

# ---- group: RH_OUT:115:Mesh
mesh_2 = Mesh(flipm)

# ----
preview = CustomPreview(Geometry=mesh_2, Material=ColourSwatch(SwatchColor=RGB(255, 255, 255)))
